# Grasshopper definition Staircase_002.gh (Grasshopper 1.0.7)
# Copyright: © 2017-2018 Pierre Cuvilliers, Caitlin Mueller, Massachusetts Institute of Technology

pi = Pi(Factor=Slider(2, range=0..2))
# STAIRCASE 001
range = Range(Domain=pi, Steps=Slider(38, range=0..100))
sine = Sine(Value=range)
cosine = Cosine(Value=range)
multiplication = Multiplication(A=sine, B=Slider(1, range=0..1))
multiplication_2 = Multiplication(A=cosine, B=Slider(2, range=0..2))
construct_point = ConstructPoint(XCoordinate=0, YCoordinate=0, ZCoordinate=0)
number_slider = Slider(0.22, range=0..1)
construct_point_2 = ConstructPoint(XCoordinate=multiplication, YCoordinate=multiplication_2, ZCoordinate=range)
vector_2pt = Vector2Pt(PointA=construct_point, PointB=construct_point_2, Unitize=False)  # -> Vector, Length
center_box = CenterBox(Base=PlaneXY(0, 0, 0), X=number_slider, Y=Slider(2, range=0..2), Z=number_slider)
construct_plane = ConstructPlane(Origin=construct_point_2, XAxis=vector_2pt.Vector, YAxis=Vector(0, 1, 0))
volume = Volume(Geometry=center_box)  # -> Volume, Centroid
orient = Orient(Geometry=center_box, Source=volume.Centroid, Target=construct_plane)  # -> Geometry, Transform
panel = Panel(orient.Geometry)
param_viewer = ParamViewer(orient.Geometry)
volume_2 = Volume(Geometry=orient.Geometry)  # -> Volume, Centroid
expression = Expression(Expression="Format(\"{0}, {1}\", x, y)")
interpolate = Interpolate(Vertices=volume_2.Centroid, Degree=3, Periodic=False, KnotStyle=1)  # -> Curve, Length, Domain
gh_python_remote = GHPythonRemote()  # -> out, linked_modules, rpy, import_statements
gene_pool = GenePool(Decimals=2, Maximum=1, Minimum=0, Value=[0, 0.06, 0.17, 0.32, 0.41, 0.48, 0.59, 0.71, 0.87, 1])
evaluate = Evaluate()
ghpython_script = GhPythonScript()  # -> Out, A
c_script = CSharpScript()  # -> Out, A
curve = Curve(interpolate.Curve)
list_length = ListLength(List=gene_pool)
range_2 = Range(Domain=Domain(0, 1), Steps=expr("x-1", list_length))
jitter = Jitter(List=range_2, Jitter=Slider(0.18, range=0..1), Seed=2)  # -> Values, Indices
graph_mapper = GraphMapper(
    jitter.Values,
    x0=0,
    x1=1,
    y0=0,
    y1=1,
    Ox=0.5399568081,
    Oy=0.7215071917,
    Px=0.950420022,
    Py=0.4869564176,
    container_name="Parabola")
graph_mapper_2 = GraphMapper(
    range_2,
    x0=0,
    x1=1,
    y0=0,
    y1=1,
    container_name="Sine",
    Equation_px=[0, 0.5634482503],
    Equation_py=[0.720289588, 0.03302663565])
pipe_variable = PipeVariable(Curve=reparameterize(curve), Parameters=gene_pool, Radii=graph_mapper, Caps=Slider(2, range=0..2))
gradient = Gradient(LowerLimit=0, UpperLimit=1, Parameter=graph_mapper_2, stops=[0: RGB(255, 255, 255), 1: RGB(0, 0, 0)])
brep = Brep(orient.Geometry)
custom_preview = CustomPreview(Geometry=brep, Material=gradient)
custom_preview_2 = CustomPreview(Geometry=pipe_variable, Material=ColourSwatch(SwatchColor=RGBA(29, 229, 255, 141)))

# ==== cluster GHPythonRemote: Connects the Grasshopper Python component to an external Python instance.
python = PythonScript()  # -> gh_parent_doc_dir
# ---------- python: Python ----------
from os import path

gh_parent_doc_dir = path.abspath(path.dirname(ghenv.Component.OnPingDocument().Owner.OnPingDocument().FilePath))
# ---------- end python ----------
# GH to python remote example.
# Pierre Cuvilliers, 2017-2018
# Released under the MIT license
# github.com/pilcru/ghpythonremote
# Runs and connects to an external python engine, and
# assigns imported modules to scriptcontext.sticky variables.
# 
# Arguments:
#       code (str): Path to the GH_to_python_sticky.py code file.
#       location (str): Path to a python executable, or to a folder
#             containing `python.exe`, or the name of a conda-created
#             virtual environment prefixed by `conda://` (`conda://env_name`).
#             If empty, finds python from your windows %PATH%.
#       run (boolean): Creates the connection, and imports new
#             modules, when turned to True. Kills the connection,
#             and deletes the references to the imports, when turned
#             to False.
#       modules (str list): List of module names to import in the
#             remote python. They will be added to the
#             scriptcontext.sticky dictionary, allowing them to be
#             reused from other python components in the same
#             Grasshopper document. Submodules (for example
#             `numpy.linalg` have to be added explicitly to this list
#             to be available later.
#       log_level (str from ['NOTSET', 'DEBUG', 'INFO', 'WARNING', 'ERROR', 'CRITICAL']):
#             Logging level to use for the local IronPython and the
#             remote python instance.
#       working_dir (str): Working directory for the remote python
#             instance.
# 
# Returns:
#       out (str): Console output with DEBUG information.
#       linked_modules (str list): list of imported module names.
#       rpy (rpyc connection object): The object representing the
#             remote Python interpreter.
location = ClusterInput()  # location (str): Path to a python executable, or to a folder containing `python.exe`, or the name of a conda-created virtual environment prefixed by `conda://` (`conda://env_name`). If empty, finds python from your windows %PATH%.
run = ClusterInput()  # run (boolean): Creates the connection, and imports new modules, when turned to True. Kills the connection,and deletes the references to the imports, when turned to False.
modules = ClusterInput()  # modules (str list): List of module names to import in the remote python. They will be added to the scriptcontext.sticky dictionary, allowing them to be reused from other python components in the same Grasshopper document. Submodules (for example `numpy.linalg` have to be added explicitly to this list to be available later.
list = ValueList({"CRITICAL", "ERROR", "WARNING", "INFO", "DEBUG", "NOTSET"}, selected="DEBUG")
panel = Panel(python)
ghpythonremote = GHPythonRemote(location=location, run=run, modules=modules, log_level=list, working_dir=panel)  # -> out, linked_modules, rpy; inputs run: Boolean, modules: list
# ---------- ghpythonremote: Python ----------
import inspect
import logging
from os import path
import sys
from time import sleep

import scriptcontext

import ghpythonremote
from ghpythonremote.connectors import GrasshopperToPythonRemote

local_log_level = getattr(logging, log_level, logging.WARNING)
logger = logging.getLogger("ghpythonremote")
logger.setLevel(local_log_level)
ch = logging.StreamHandler()
ch.setLevel(local_log_level)
formatter = logging.Formatter("%(levelname)s: %(name)s:\n%(message)s")
ch.setFormatter(formatter)
logger.handlers = []
logger.addHandler(ch)
logger = logging.getLogger("ghpythonremote.GH_to_python")

ROOT = path.abspath(path.dirname(inspect.getfile(ghpythonremote)))
rpyc_server_py = path.join(ROOT, "pythonservice.py")

# Set connection to CLOSED if this is the first run
# and initialize set of linked modules
try:
    remote_python_status
except NameError:
    remote_python_status = "CLOSED"
    lkd_modules = set()

# Wait for connection to connect or terminate
timer = 0
while remote_python_status == "CONNECTING" or remote_python_status == "CLOSING":
    sleep(1)
    timer += 1
    if timer == 10:
        try:
            gh2py_manager.__exit__(*sys.exc_info())
        except Exception:
            pass
        remote_python_status = "CLOSED"
        lkd_modules = set()
        raise RuntimeError(
            "Connection left in an inconsistent state and not returning. Reset "
            "everything."
        )

if run:
    if not remote_python_status == "OPEN":
        remote_python_status = "CONNECTING"
        gh2py_manager = GrasshopperToPythonRemote(
            rpyc_server_py,
            location=location,
            timeout=10,
            port=None,
            log_level=log_level,
            working_dir=working_dir,
        )
        gh2py = gh2py_manager.__enter__()
        remote_python_status = "OPEN"

    # Stuff that we can reach
    rpymod = gh2py.py_remote_modules  # A getter function for a named python module
    rpy = gh2py.connection  # Represents the remote instance root object
    scriptcontext.sticky["rpy"] = rpy
    # Add modules
    for mod in modules:
        try:
            scriptcontext.sticky[mod] = rpymod(mod)
            lkd_modules.add(mod)
        except ImportError:
            gh2py_manager.__exit__(*sys.exc_info())
            raise

elif not remote_python_status == "CLOSED":
    remote_python_status = "CLOSING"
    # Remove linked modules
    for mod in lkd_modules:
        del scriptcontext.sticky[mod]
    del scriptcontext.sticky["rpy"]
    gh2py_manager.__exit__(*sys.exc_info())
    lkd_modules = set()
    remote_python_status = "CLOSED"

# Change variable name because ghpython resets outputs to None before each run
linked_modules = lkd_modules

logger.info("GH to python connection is {}".format(remote_python_status))
# ---------- end ghpythonremote ----------
out = ClusterOutput(ghpythonremote.out)  # Console output.
linked_modules = ClusterOutput(ghpythonremote.linked_modules)  # Names of modules that were successfully added to the scriptcontext.sticky dictionary.
rpy = ClusterOutput(ghpythonremote.rpy)  # The object representing the remote python instance
python_2 = PythonScript(module_names=ghpythonremote.linked_modules)  # -> import_statements; inputs module_names: list
# ---------- python_2: Python ----------
import_statements = ["import scriptcontext as sc"]
for module_name in module_names:
    import_statements.append("{0} = sc.sticky['{0}']".format(module_name))

if len(module_names) == 0:
    import_statements = []
# ---------- end python_2 ----------
import_statements = ClusterOutput(python_2)  # Useful import statements to use the imported modules in your scripts.
