# Grasshopper definition Staircase_002_LIVE.gh (Grasshopper 1.0.7)
# plug-ins: Fologram For Grasshopper Utilities

# ----
# Stair Case 001
number_slider = Slider(0, range=0..2)
pi = Pi(Factor=number_slider)
pi_2 = Pi(Factor=Slider(1.67, range=0..2))
construct_domain = ConstructDomain(DomainStart=pi, DomainEnd=pi_2)
range = Range(Domain=construct_domain, Steps=Slider(19, range=0..100))
sine = Sine(Value=range)
cosine = Cosine(Value=range)
construct_point = ConstructPoint(XCoordinate=0, YCoordinate=0, ZCoordinate=Slider(9.21, range=0..10))
construct_point_2 = ConstructPoint(XCoordinate=sine, YCoordinate=cosine, ZCoordinate=range)
number_slider_2 = Slider(0.08, range=0..1)
vector_2pt = Vector2Pt(PointA=construct_point, PointB=construct_point_2, Unitize=False)  # -> Vector, Length
center_box = CenterBox(Base=PlaneXY(0, 0, 0), X=number_slider_2, Y=Slider(1.74, range=0..2), Z=number_slider_2)
construct_plane = ConstructPlane(Origin=construct_point_2, XAxis=vector_2pt.Vector, YAxis=Vector(0, 1, 0))
volume = Volume(Geometry=center_box)  # -> Volume, Centroid
orient = Orient(Geometry=center_box, Source=volume.Centroid, Target=construct_plane)  # -> Geometry, Transform
volume_2 = Volume(Geometry=orient.Geometry)  # -> Volume, Centroid
gene_pool = GenePool(Decimals=2, Maximum=1, Minimum=0, Value=[0, 0.13, 0.26, 0.4, 0.55, 0.69, 0.75, 0.89, 0.93, 1])
number_slider_3 = Slider(2, range=0..2)
interpolate = Interpolate(Vertices=volume_2.Centroid, Degree=3, Periodic=False, KnotStyle=1)  # -> Curve, Length, Domain
list_length = ListLength(List=gene_pool)
range_2 = Range(Domain=Domain(0, 1), Steps=expr("x-1", list_length))
mesh_pipe = MeshPipe(Polylines=interpolate.Curve, NumberOfSides=4, Tolerance=0.1, Radius=1, Cap=False, Join=False)
pipe = Pipe(Curve=interpolate.Curve, Radius=1, Caps=number_slider_3)
graph_mapper = GraphMapper(
    range_2,
    x0=0,
    x1=1,
    y0=0,
    y1=1,
    Ox=0.7289862037,
    Oy=0.3362315893,
    Px=0.9289851785,
    Py=0.5710144043,
    container_name="Parabola")
graph_mapper_2 = GraphMapper(
    graph_mapper,
    x0=0,
    x1=1,
    y0=0,
    y1=1,
    container_name="Sine",
    Equation_px=[0.1898547113, 0.584058702],
    Equation_py=[0.8057972193, 0.4057971239])
pipe_variable = PipeVariable(Curve=reparameterize(interpolate.Curve), Parameters=gene_pool, Radii=graph_mapper_2, Caps=number_slider_3)
brep = Brep(orient.Geometry)
gradient = Gradient(LowerLimit=0, UpperLimit=1, Parameter=graph_mapper_2, stops=[0: RGB(255, 255, 255), 1: RGB(0, 0, 0)])
custom_preview = CustomPreview(Geometry=pipe_variable, Material=ColourSwatch(SwatchColor=RGBA(0, 255, 255, 128)))
custom_preview_2 = CustomPreview(Geometry=brep, Material=gradient)

# ----
# Euclid's Elements
# Book 1: Proposition1
construct_point_3 = ConstructPoint(XCoordinate=0, YCoordinate=0, ZCoordinate=0)
unit_x = UnitX(Factor=Slider(1, range=0..1))
move = Move(Geometry=construct_point_3, Motion=unit_x)  # -> Geometry, Transform
merge = Merge(Data1=construct_point_3, Data2=move.Geometry)
circle = Circle(Plane=merge, Radius=1)
dispatch = Dispatch(List=flatten(circle), DispatchPattern=[True, False])  # -> ListA, ListB
curve_curve = CurveCurve(CurveA=dispatch.ListA, CurveB=dispatch.ListB)  # -> Points, ParamsA, ParamsB
dispatch_2 = Dispatch(List=curve_curve.Points, DispatchPattern=[True, False])  # -> ListA, ListB
number_slider_4 = Slider(0.24, range=0..1)
boolean_toggle = BooleanToggle(True)
point = Point(construct_point_3)
point_2 = Point(dispatch_2.ListA)
point_3 = Point(dispatch_2.ListB)
point_4 = Point(move.Geometry)
text_tag_3d = TextTag3D(Location=point_2, Text="C", Size=number_slider_4, Justification=7)
text_tag_3d_2 = TextTag3D(Location=point, Text="A", Size=number_slider_4, Justification=7)
text_tag_3d_3 = TextTag3D(Location=point_4, Text="B", Size=number_slider_4, Justification=7)
polyline = PolyLine(Vertices=flatten([point, point_4, point_3]), Closed=boolean_toggle)
polyline_2 = PolyLine(Vertices=flatten([point, point_4, point_2]), Closed=boolean_toggle)
