# Grasshopper definition Staircase_003.gh (Grasshopper 1.0.7)

# ----
# Euclid's Elements
# Book 1: Proposition1
number_slider = Slider(1, range=0..1)  # disabled
construct_point = ConstructPoint(XCoordinate=0, YCoordinate=0, ZCoordinate=0)  # disabled
unit_x = UnitX(Factor=number_slider)  # disabled
move = Move(Geometry=construct_point, Motion=unit_x)  # -> Geometry, Transform; disabled
merge = Merge(Data1=construct_point, Data2=move.Geometry)  # disabled
circle = Circle(Plane=merge, Radius=1)  # disabled
dispatch = Dispatch(List=flatten(circle), DispatchPattern=[True, False])  # -> ListA, ListB; disabled
curve_curve = CurveCurve(CurveA=dispatch.ListA, CurveB=dispatch.ListB)  # -> Points, ParamsA, ParamsB; disabled
dispatch_2 = Dispatch(List=curve_curve.Points, DispatchPattern=[True, False])  # -> ListA, ListB; disabled
number_slider_2 = Slider(0.24, range=0..1)  # disabled
boolean_toggle = BooleanToggle(True)  # disabled
point = Point(construct_point)  # disabled
point_2 = Point(dispatch_2.ListA)  # disabled
point_3 = Point(dispatch_2.ListB)  # disabled
point_4 = Point(move.Geometry)  # disabled
panel = Panel("A")  # disabled
panel_2 = Panel("B")  # disabled
panel_3 = Panel("C")  # disabled
text_tag_3d = TextTag3D(Location=point_2, Text=panel_3, Size=number_slider_2, Justification=7)  # disabled
text_tag_3d_2 = TextTag3D(Location=point, Text=panel, Size=number_slider_2, Justification=7)  # disabled
text_tag_3d_3 = TextTag3D(Location=point_4, Text=panel_2, Size=number_slider_2, Justification=7)  # disabled
polyline = PolyLine(Vertices=flatten([point, point_4, point_3]), Closed=boolean_toggle)  # disabled
polyline_2 = PolyLine(Vertices=flatten([point, point_4, point_2]), Closed=boolean_toggle)  # disabled

# ----
# Stair Case 002
number_slider_3 = Slider(7, range=0..10)
subtraction = Subtraction(A=number_slider_3, B=Slider(5, range=0..10))
number_slider_4 = Slider(10, range=0..100)
radial = Radial(Plane=PlaneXY(0, 0, 0), Size=1, ExtentR=number_slider_3, ExtentP=number_slider_3)  # -> Cells, Points
tree_statistics = TreeStatistics(Tree=radial.Points)  # -> Paths, Length, Count
panel_4 = Panel(tree_statistics.Paths)
list_item = ListItem(List=tree_statistics.Paths, Index=subtraction, Wrap=True)
cull_index = CullIndex(List=tree_statistics.Paths, Indices=subtraction, Wrap=True)
panel_5 = Panel(cull_index)
tree_branch = TreeBranch(Tree=radial.Points, Path=list_item, MaintainPaths=True)
tree_branch_2 = TreeBranch(Tree=radial.Points, Path=cull_index, MaintainPaths=True)
tree_statistics_2 = TreeStatistics(Tree=tree_branch)  # -> Paths, Length, Count
tree_statistics_3 = TreeStatistics(Tree=tree_branch_2)  # -> Paths, Length, Count
range = Range(Domain=number_slider_4, Steps=expr("x-1", tree_statistics_3.Count))
range_2 = Range(Domain=number_slider_4, Steps=tree_statistics_2.Count)
unit_z = UnitZ(Factor=range)
unit_z_2 = UnitZ(Factor=range_2)
move_2 = Move(Geometry=tree_branch_2, Motion=unit_z)  # -> Geometry, Transform
move_3 = Move(Geometry=tree_branch, Motion=unit_z_2)  # -> Geometry, Transform
interpolate = Interpolate(Vertices=move_2.Geometry, Degree=3, Periodic=False, KnotStyle=1)  # -> Curve, Length, Domain
interpolate_2 = Interpolate(Vertices=move_3.Geometry, Degree=3, Periodic=False, KnotStyle=1)  # -> Curve, Length, Domain
loft = Loft(
    Curves=flatten(interpolate.Curve),
    Options={Adjust=False, Closed=False, LoftEnds=0, LoftSimp=0, LoftType=0, Rebuild=10, Refit=0.01})
number_slider_5 = Slider(10, range=0..10)
deconstruct_brep = DeconstructBrep(Brep=loft)  # -> Faces, Edges, Vertices
divide_surface = DivideSurface(Surface=deconstruct_brep.Faces, UCount=number_slider_5, VCount=number_slider_5)  # -> Points, Normals, Parameters
amplitude = Amplitude(Vector=divide_surface.Normals, Amplitude=Slider(1.38, range=0..3))
move_4 = Move(Geometry=divide_surface.Points, Motion=amplitude)  # -> Geometry, Transform
surface_from_points = SurfaceFromPoints(Points=flatten(move_4.Geometry), UCount=expr("x+1", number_slider_5), Interpolate=False)
deconstruct_brep_2 = DeconstructBrep(Brep=surface_from_points)  # -> Faces, Edges, Vertices
gene_pool = GenePool(Decimals=2, Maximum=1, Minimum=0, Value=[0, 0.18, 0.42, 0.66, 1])
gene_pool_2 = GenePool(Decimals=2, Maximum=1, Minimum=0, Value=[0.6177077613, 0.9968862897, 0.3476413197, 0.5207035907, 0.2693708796])
curve = Curve(deconstruct_brep.Edges)
curve_2 = Curve(deconstruct_brep_2.Edges)
list_item_2 = ListItem(List=curve, Index=0, Wrap=True)  # -> Item, Item1, Item2, Item3
list_item_3 = ListItem(List=curve_2, Index=0, Wrap=True)  # -> Item, Item1, Item2, Item3
graph_mapper = GraphMapper(
    gene_pool,
    x0=0,
    x1=1,
    y0=0,
    y1=1,
    container_name="Sine",
    Equation_px=[0.01065019239, 0.1805526018],
    Equation_py=[0.3793694377, 0.7128552198])
loft_2 = Loft(
    Curves=[list_item_2.Item, list_item_3.Item],
    Options={Adjust=False, Closed=False, LoftEnds=0, LoftSimp=0, LoftType=0, Rebuild=10, Refit=0.01})
loft_3 = Loft(
    Curves=[list_item_2.Item1, list_item_3.Item1],
    Options={Adjust=False, Closed=False, LoftEnds=0, LoftSimp=0, LoftType=0, Rebuild=10, Refit=0.01})
loft_4 = Loft(
    Curves=[list_item_2.Item2, list_item_3.Item2],
    Options={Adjust=False, Closed=False, LoftEnds=0, LoftSimp=0, LoftType=0, Rebuild=10, Refit=0.01})
loft_5 = Loft(
    Curves=[list_item_2.Item3, list_item_3.Item3],
    Options={Adjust=False, Closed=False, LoftEnds=0, LoftSimp=0, LoftType=0, Rebuild=10, Refit=0.01})
brep = Brep(deconstruct_brep.Faces)
brep_2 = Brep(deconstruct_brep_2.Faces)
pipe_variable = PipeVariable(Curve=reparameterize(interpolate_2.Curve), Parameters=gene_pool, Radii=graph_mapper, Caps="2")
merge_2 = Merge(Data1=loft_2, Data2=loft_3, Data3=loft_4, Data4=loft_5)
custom_preview = CustomPreview(Geometry=pipe_variable, Material=ColourSwatch(SwatchColor=RGB(66, 65, 255)))
custom_preview_2 = CustomPreview(Geometry=[brep, brep_2], Material=ColourSwatch(SwatchColor=RGBA(235, 20, 255, 104)))
custom_preview_3 = CustomPreview(Geometry=merge_2, Material=ColourSwatch(SwatchColor=RGBA(0, 255, 255, 132)))

param_viewer = ParamViewer(tree_statistics.Paths)
param_viewer_2 = ParamViewer(cull_index)
