# Grasshopper definition Staircase_003_LIVE.gh (Grasshopper 1.0.7)
# plug-ins: Bifocals

# ----
# Euclid's Elements
# Book 1: Proposition 2
number_slider = Slider(0.9, range=0..1)
range = Range(Domain=number_slider, Steps=10)
construct_point = ConstructPoint(XCoordinate=0, YCoordinate=0, ZCoordinate=0)
circle = Circle(Plane=construct_point, Radius=1)
evaluate_curve = EvaluateCurve(Curve=reparameterize(circle), Parameter=range)  # -> Point, Tangent, Angle
evaluate_curve_2 = EvaluateCurve(Curve=reparameterize(circle), Parameter=Slider(1, range=0..1))  # -> Point, Tangent, Angle
line = Line(StartPoint=construct_point, EndPoint=evaluate_curve.Point)
vector_2pt = Vector2Pt(PointA=construct_point, PointB=evaluate_curve.Point, Unitize=False)  # -> Vector, Length
line_2 = Line(StartPoint=construct_point, EndPoint=evaluate_curve_2.Point)
vector_2pt_2 = Vector2Pt(PointA=construct_point, PointB=evaluate_curve_2.Point, Unitize=False)  # -> Vector, Length
end_points = EndPoints(Curve=line)  # -> Start, End
end_points_2 = EndPoints(Curve=line_2)  # -> Start, End
vector_display = VectorDisplay(Anchor=construct_point, Vector=vector_2pt.Vector)
vector_display_2 = VectorDisplay(Anchor=construct_point, Vector=vector_2pt_2.Vector)
evaluate_curve_3 = EvaluateCurve(Curve=reparameterize(line_2), Parameter=Slider(0.41, range=0..1))  # -> Point, Tangent, Angle
line_3 = Line(StartPoint=construct_point, EndPoint=evaluate_curve_3.Point)
length = Length(Curve=line_3)
circle_2 = Circle(Plane=construct_point, Radius=length)
circle_3 = Circle(Plane=evaluate_curve_3.Point, Radius=length)
end_points_3 = EndPoints(Curve=line_3)  # -> Start, End
curve_curve = CurveCurve(CurveA=circle_2, CurveB=circle_3)  # -> Points, ParamsA, ParamsB
circle_4 = Circle(Plane=curve_curve.Points, Radius=length)
evaluate_curve_4 = EvaluateCurve(Curve=reparameterize(circle_4), Parameter=Slider(0.78, range=0..1))  # -> Point, Tangent, Angle
dispatch = Dispatch(List=flatten(curve_curve.Points), DispatchPattern=[True, False])  # -> ListA, ListB
dispatch_2 = Dispatch(List=flatten(evaluate_curve_4.Point), DispatchPattern=[True, False])  # -> ListA, ListB
point = Point(dispatch.ListB)
point_2 = Point(dispatch_2.ListB)
line_4 = Line(StartPoint=evaluate_curve_3.Point, EndPoint=point_2)
line_5 = Line(StartPoint=end_points_3.Start, EndPoint=curve_curve.Points)
line_6 = Line(StartPoint=end_points_3.End, EndPoint=curve_curve.Points)
curve = Curve(line)
merge = Merge(Data1=curve, Data2=line_5, Data3=line_6, Data4=line_4)

# ----
# Stair Case 002
number_slider_2 = Slider(6, range=0..10)
radial = Radial(Plane=PlaneXY(0, 0, 0), Size=1, ExtentR=number_slider_2, ExtentP=number_slider_2)  # -> Cells, Points
subtraction = Subtraction(A=number_slider_2, B=Slider(5, range=0..9))
tree_statistics = TreeStatistics(Tree=radial.Points)  # -> Paths, Length, Count
point_3 = Point(radial.Points)
param_viewer = ParamViewer(tree_statistics.Paths)
panel = Panel(tree_statistics.Paths)
number_slider_3 = Slider(8, range=0..10)
cull_index = CullIndex(List=tree_statistics.Paths, Indices=subtraction, Wrap=True)
list_item = ListItem(List=tree_statistics.Paths, Index=subtraction, Wrap=True)
tree_branch = TreeBranch(Tree=point_3, Path=cull_index, MaintainPaths=True)
panel_2 = Panel(list_item)
tree_branch_2 = TreeBranch(Tree=radial.Points, Path=list_item, MaintainPaths=True)
panel_3 = Panel(tree_branch)
param_viewer_2 = ParamViewer(tree_branch)
tree_statistics_2 = TreeStatistics(Tree=tree_branch)  # -> Paths, Length, Count
tree_statistics_3 = TreeStatistics(Tree=tree_branch_2)  # -> Paths, Length, Count
range_2 = Range(Domain=number_slider_3, Steps=expr("x-1", tree_statistics_2.Count))
range_3 = Range(Domain=number_slider_3, Steps=tree_statistics_3.Count)
unit_z = UnitZ(Factor=range_3)
unit_z_2 = UnitZ(Factor=range_2)
move = Move(Geometry=tree_branch, Motion=unit_z_2)  # -> Geometry, Transform
move_2 = Move(Geometry=tree_branch_2, Motion=unit_z)  # -> Geometry, Transform
interpolate = Interpolate(Vertices=move.Geometry, Degree=3, Periodic=False, KnotStyle=1)  # -> Curve, Length, Domain
interpolate_2 = Interpolate(Vertices=move_2.Geometry, Degree=3, Periodic=False, KnotStyle=1)  # -> Curve, Length, Domain
loft = Loft(
    Curves=flatten(interpolate.Curve),
    Options={Adjust=False, Closed=False, LoftEnds=0, LoftSimp=0, LoftType=0, Rebuild=10, Refit=0.01})
number_slider_4 = Slider(10, range=0..10)
gene_pool = GenePool(Decimals=2, Maximum=1, Minimum=0, Value=[0, 0.22, 0.39, 0.67, 1])
deconstruct_brep = DeconstructBrep(Brep=loft)  # -> Faces, Edges, Vertices
graph_mapper = GraphMapper(
    gene_pool,
    x0=0,
    x1=1,
    y0=0,
    y1=1,
    container_name="Sine",
    Equation_px=[0.05941993743, 0.3023274839],
    Equation_py=[0.3376811743, 0.8051629663])
divide_surface = DivideSurface(Surface=deconstruct_brep.Faces, UCount=number_slider_4, VCount=number_slider_4)  # -> Points, Normals, Parameters
amplitude = Amplitude(Vector=divide_surface.Normals, Amplitude=Slider(1.19, range=0..2))
move_3 = Move(Geometry=divide_surface.Points, Motion=amplitude)  # -> Geometry, Transform
surface_from_points = SurfaceFromPoints(Points=flatten(move_3.Geometry), UCount=expr("X+1", number_slider_4), Interpolate=False)
deconstruct_brep_2 = DeconstructBrep(Brep=surface_from_points)  # -> Faces, Edges, Vertices
curve_2 = Curve(deconstruct_brep.Edges)
curve_3 = Curve(deconstruct_brep_2.Edges)
pipe_variable = PipeVariable(Curve=reparameterize(interpolate_2.Curve), Parameters=gene_pool, Radii=graph_mapper, Caps="2")
list_item_2 = ListItem(List=curve_2, Index=0, Wrap=True)  # -> Item, Item1, Item2, Item3
list_item_3 = ListItem(List=curve_3, Index=0, Wrap=True)  # -> Item, Item1, Item2, Item3
loft_2 = Loft(
    Curves=[list_item_2.Item, list_item_3.Item],
    Options={Adjust=False, Closed=False, LoftEnds=0, LoftSimp=0, LoftType=0, Rebuild=10, Refit=0.01})
loft_3 = Loft(
    Curves=[list_item_2.Item1, list_item_3.Item1],
    Options={Adjust=False, Closed=False, LoftEnds=0, LoftSimp=0, LoftType=0, Rebuild=10, Refit=0.01})
loft_4 = Loft(
    Curves=[list_item_2.Item2, list_item_3.Item2],
    Options={Adjust=False, Closed=False, LoftEnds=0, LoftSimp=0, LoftType=0, Rebuild=10, Refit=0.01})
loft_5 = Loft(
    Curves=[list_item_2.Item3, list_item_3.Item3],
    Options={Adjust=False, Closed=False, LoftEnds=0, LoftSimp=0, LoftType=0, Rebuild=10, Refit=0.01})
brep = Brep(deconstruct_brep.Faces)
brep_2 = Brep(deconstruct_brep_2.Faces)
merge_2 = Merge(Data1=loft_2, Data2=loft_3, Data3=loft_4, Data4=loft_5)
custom_preview = CustomPreview(Geometry=pipe_variable, Material=ColourSwatch(SwatchColor=RGB(130, 250, 255)))
custom_preview_2 = CustomPreview(Geometry=[brep, brep_2], Material=ColourSwatch(SwatchColor=RGBA(216, 26, 255, 114)))
custom_preview_3 = CustomPreview(Geometry=merge_2, Material=ColourSwatch(SwatchColor=RGBA(244, 157, 0, 114)))
