# Grasshopper definition Staircase_004.gh (Grasshopper 1.0.7)

number_slider = Slider(5, range=0..10)
triangular = Triangular(Plane=PlaneXY(0, 0, 0), Size=number_slider, ExtentX=number_slider, ExtentY=number_slider)  # -> Cells, Points
# SPLIT TREE
radial = Radial(Plane=PlaneXY(0, 0, 0), Size=number_slider, ExtentR=number_slider, ExtentP=number_slider)  # -> Cells, Points
rectangular = Rectangular(Plane=PlaneXY(0, 0, 0), SizeX=number_slider, SizeY=number_slider, ExtentX=number_slider, ExtentY=number_slider)  # -> Cells, Points
split_tree = SplitTree(Data=rectangular.Points, Masks=flatten("{*;*;(1,3,...)}[(1,3,...)]"))  # -> Positive, Negative
split_tree_2 = SplitTree(Data=rectangular.Points, Masks=flatten("{*;*;(1,3,...)}[(0,2,...)]"))  # -> Positive, Negative
param_viewer = ParamViewer(rectangular.Points)
panel = Panel(rectangular.Points)
split_tree_3 = SplitTree(Data=rectangular.Points, Masks=flatten("{*;*;(0,2,...)}[(1,3,...)]"))  # -> Positive, Negative
split_tree_4 = SplitTree(Data=rectangular.Points, Masks=flatten("{*;*;(0,2,...)}[(0,2,...)]"))  # -> Positive, Negative
number_slider_2 = Slider(0.42, range=0..1)
point = Point(split_tree_4.Positive)
point_2 = Point(split_tree_2.Positive)
point_3 = Point(split_tree_3.Positive)
point_4 = Point(split_tree.Positive)
cylinder = Cylinder(Base=point_2, Radius=0.5, Length=1)
sphere = Sphere(Base=point_3, Radius=number_slider_2)
cone = Cone(Base=point_4, Radius=0.5, Length=1)  # -> Cone, Tip
center_box = CenterBox(Base=point, X=number_slider_2, Y=number_slider_2, Z=number_slider_2)
