# Grasshopper definition Staircase_004_SPLITTREE.gh (Grasshopper 1.0.7)

construct_domain = ConstructDomain(DomainStart=Slider(5, range=0..10), DomainEnd="10")
random = Random(Range=construct_domain, Number="4", Seed=Slider(58, range=0..100))
construct_domain_2 = ConstructDomain(DomainStart=Slider(22, range=0..140), DomainEnd=Slider(106, range=0..140))
construct_domain_3 = ConstructDomain(DomainStart=Slider(11, range=0..140), DomainEnd=Slider(39, range=0..140))
jitter = Jitter(List=random, Jitter=Slider(0.25, range=0..1), Seed=Slider(57, range=0..100))  # -> graft(Values), Indices
range = Range(Domain=construct_domain_2, Steps=10)
range_2 = Range(Domain=construct_domain_3, Steps=10)
explode_tree = ExplodeTree(Data=jitter.Values)  # -> _0000, _0001, _0002, _0003
number_slider = Slider(96, range=0..100)
number_slider_2 = Slider(13, range=0..100)
# SPLIT TREE
plane = Plane(PlaneXY(0, 0, 0))
random_2 = Random(Range=range, Number=explode_tree._0003, Seed=number_slider)
random_3 = Random(Range=range_2, Number=explode_tree._0000, Seed=number_slider_2)
random_4 = Random(Range=range_2, Number=explode_tree._0001, Seed=number_slider)
random_5 = Random(Range=range, Number=explode_tree._0002, Seed=number_slider_2)
square = Square(Plane=plane, Size="10", ExtentX=Slider(14, range=0..50), ExtentY=Slider(14, range=0..50))  # -> simplify(Cells), simplify(Points)
ghpython_script = GhPythonScript(A=random_3, B=random_4, C=Slider(3, range=1..10), a=random_5, b=random_2, c=Slider(4, range=1..10))  # -> out, code; inputs A: Int32, B: Int32, C: Int32, a: Int32, b: Int32, c: Int32, d: Int32, e: Int32
# ---------- ghpython_script: Python ----------
__author__ = "Sculpture"
__version__ = "2022.06.18"

import rhinoscriptsyntax as rs

code = ["{", int(A/C), "to", int(B/C), "}", "[", int(a/c), "to", int(b/c), "]"]
# ---------- end ghpython_script ----------
text_join = TextJoin(Text=ghpython_script.code)
param_viewer = ParamViewer(square.Cells)
panel = Panel(text_join)
split_tree = SplitTree(Data=square.Points, Masks=flatten(text_join))  # -> Positive, Negative
boolean_toggle = BooleanToggle(True)
clean_tree = CleanTree(RemoveNulls=True, RemoveInvalid=True, RemoveEmpty=boolean_toggle, Tree=split_tree.Positive)
clean_tree_2 = CleanTree(RemoveNulls=True, RemoveInvalid=True, RemoveEmpty=boolean_toggle, Tree=split_tree.Positive)
cull_duplicates = CullDuplicates(Points=[clean_tree, clean_tree_2], Tolerance=0.1, CullMode=3)  # -> Points, Indices, Valence
point = Point(cull_duplicates.Points)
circle = Circle(Plane=point, Radius=Slider(8, range=0..20))
dispatch = Dispatch(List=circle, DispatchPattern=[True, False])  # -> ListA, ListB
curve = Curve(flatten(dispatch.ListA))
curve_2 = Curve(flatten(dispatch.ListB))
region_union = RegionUnion(Curves=curve_2)
