# Grasshopper definition Staircase_004_SPLITTREE_b.gh (Grasshopper 1.0.7)
# plug-ins: Kangaroo2 Components

construct_domain = ConstructDomain(DomainStart=Slider(5, range=0..10), DomainEnd=Slider(5, range=0..10))
random = Random(Range=construct_domain, Number="4", Seed=Slider(8, range=0..100))
construct_domain_2 = ConstructDomain(DomainStart=Slider(0, range=0..140), DomainEnd=Slider(60, range=0..140))
jitter = Jitter(List=random, Jitter=Slider(0.13, range=0..1), Seed=Slider(30, range=0..100))  # -> graft(Values), Indices
range = Range(Domain=construct_domain_2, Steps=10)
explode_tree = ExplodeTree(Data=jitter.Values)  # -> _0000, _0001, _0002, _0003
number_slider = Slider(9, range=0..50)
# SPLIT TREE
# random map
# generator
panel = Panel("10")
random_2 = Random(Range=range, Number=explode_tree._0003, Seed=Slider(100, range=0..100))
random_3 = Random(Range=range, Number=explode_tree._0001, Seed=Slider(100, range=0..100))
random_4 = Random(Range=range, Number=explode_tree._0002, Seed=Slider(100, range=0..100))
random_5 = Random(Range=range, Number=explode_tree._0000, Seed=Slider(26, range=0..100))
square = Square(Plane=PlaneXY(0, 0, 0), Size=panel, ExtentX=number_slider, ExtentY=number_slider)  # -> Cells, simplify(Points)
construct_domain_3 = ConstructDomain(DomainStart="1", DomainEnd=Slider(6, range=1..10))
construct_domain_4 = ConstructDomain(DomainStart="1", DomainEnd=Slider(9, range=1..10))
range_2 = Range(Domain=construct_domain_3, Steps=10)
range_3 = Range(Domain=construct_domain_4, Steps=10)
ghpython_script = GhPythonScript(A=Slider(3, range=0..10), B=random_3, C=range_2, a=random_4, b=random_2, c=range_3, mod=Slider(2, range=0..10))  # -> out, code; inputs A: Int32, B: Int32, C: Int32, a: Int32, b: Int32, c: Int32, mod: Int32
# ---------- ghpython_script: Python ----------
__author__ = "Sculpture"
__version__ = "2022.06.18"

import rhinoscriptsyntax as rs

#code = ["{", int(A/C), "to", int(B/C), "}", "[", int(a/c), "to", int(b/c), "]"]

#code = ["{", int(A/C), ",",int(B/C) + mod ,",...", "}", "[", int(a/c), "to", int(b/c), "]"]

code = ["{", int(A/C), ",",int(B/C) + mod ,",...", "}", "[", int(a/c), "to", int(b/c), "]"]
# ---------- end ghpython_script ----------
param_viewer = ParamViewer(square.Points)
text_join = TextJoin(Text=ghpython_script.code)  # -> simplify(Result)
param_viewer_2 = ParamViewer(text_join)
panel_2 = Panel(text_join)
split_tree = SplitTree(Data=square.Points, Masks=flatten(text_join))  # -> Positive, Negative
boolean_toggle = BooleanToggle(True)
clean_tree = CleanTree(RemoveNulls=True, RemoveInvalid=True, RemoveEmpty=boolean_toggle, Tree=split_tree.Positive)
clean_tree_2 = CleanTree(RemoveNulls=True, RemoveInvalid=True, RemoveEmpty=boolean_toggle, Tree=split_tree.Positive)
construct_domain_5 = ConstructDomain(DomainStart=Slider(6.807, range=1..10), DomainEnd=Slider(15, range=1..20))
cull_duplicates = CullDuplicates(Points=[clean_tree, clean_tree_2], Tolerance=0.1, CullMode=3)  # -> Points, Indices, Valence
range_4 = Range(Domain=construct_domain_5, Steps=10)
point = Point(cull_duplicates.Points)
jitter_2 = Jitter(List=range_4, Jitter=Slider(0.61, range=0..1), Seed=Slider(54, range=0..100))  # -> Values, Indices
circle = Circle(Plane=point, Radius=jitter_2.Values)
dispatch = Dispatch(List=flatten(circle), DispatchPattern=[True, False])  # -> ListA, ListB
pi = Pi(Factor="2")
curve = Curve(flatten(dispatch.ListA))
range_5 = Range(Domain=pi, Steps=Slider(6, range=0..10))
number_slider_2 = Slider(33, range=0..100)
region_union = RegionUnion(Curves=curve)
cosine = Cosine(Value=range_5)
sine = Sine(Value=range_5)
boundary_surfaces = BoundarySurfaces(Edges=region_union)
construct_domain_6 = ConstructDomain(DomainStart=Slider(0.43, range=0..1), DomainEnd=Slider(0.28, range=0..1))
multiplication = Multiplication(A=sine, B=number_slider_2)
multiplication_2 = Multiplication(A=cosine, B=number_slider_2)
multiplication_3 = Multiplication(A=range_5, B=number_slider_2)
list_item = ListItem(List=region_union, Index=0, Wrap=True)
range_6 = Range(Domain=construct_domain_6, Steps=Slider(49, range=0..100))
volume = Volume(Geometry=region_union)  # -> Volume, Centroid
curve_2 = Curve(reparameterize(list_item))
surface = Surface(graft(boundary_surfaces))
construct_point = ConstructPoint(XCoordinate=multiplication, YCoordinate=multiplication_2, ZCoordinate=multiplication_3)
evaluate_curve = EvaluateCurve(Curve=curve_2, Parameter=range_6)  # -> Point, Tangent, Angle
orient = Orient(Geometry=surface, Source=volume.Centroid, Target=construct_point)  # -> Geometry, Transform
orient_2 = Orient(Geometry=evaluate_curve.Point, Source=volume.Centroid, Target=construct_point)  # -> Geometry, Transform
list_length = ListLength(List=orient.Geometry)
pi_2 = Pi(Factor=Slider(1.58, range=0..2))
construct_point_2 = ConstructPoint(XCoordinate=0, YCoordinate=0, ZCoordinate=0)
unit_z = UnitZ(Factor=1)
range_7 = Range(Domain=pi_2, Steps=expr("x-1", list_length))
line_sdl = LineSDL(Start=construct_point_2, Direction=unit_z, Length=1)
area = Area(Geometry=orient.Geometry)  # -> Area, Centroid
interpolate = Interpolate(Vertices=orient_2.Geometry, Degree=3, Periodic=False, KnotStyle=1)  # -> Curve, Length, Domain
rotate_3d = Rotate3D(Geometry=orient.Geometry, Angle=range_7, Center=area.Centroid, Axis=line_sdl)  # -> Geometry, Transform
deconstruct_brep = DeconstructBrep(Brep=rotate_3d.Geometry)  # -> Faces, Edges, Vertices
multipipe = MultiPipe(
    Curves=[deconstruct_brep.Edges, interpolate.Curve],
    NodeSize=Slider(4, range=0..10),
    EndOffset=1,
    StrutSize=1,
    Segment=0,
    KinkAngle=0.6,
    CubeFit=0,
    Caps="1")
custom_preview = CustomPreview(Geometry=multipipe, Material=ColourSwatch(SwatchColor=RGB(29, 222, 255)))
custom_preview_2 = CustomPreview(Geometry=rotate_3d.Geometry, Material=ColourSwatch(SwatchColor=RGB(193, 65, 255)))
